# Grasshopper definition BBLayer Example.gh (Grasshopper 0.9.72)
# plug-ins: Bowerbird

# ---- group: Input
number_slider = Slider(1, range=0..10)
number_slider_2 = Slider(8.8, range=0..10)
base_plane = Plane(PlaneXY(0, 0, 0))
brep = Brep(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)

# ---- group: Convert breps to meshes
mesh = MeshBrep(
    Brep=brep,
    Settings={GridMaxCount=0, GridMinCount=16, JaggedSeams=False, MaxEdgeLength=0, MinEdgeLength=0.0001, MinTolerance=0, Refine=True, RefineAngle=0, RelativeTolerance=0.65, SimplePlanes=True, Tolerance=0})

# ----
panel = Panel("""Bowerbird
by Thomas J. Oberbichler""")

# ---- group: Bowerbird Layer Component
bblayer = BBSlices(Volume=mesh, Thickness=number_slider, BasePlane=base_plane, BoderWidth=number_slider_2)  # -> Outlines, Inlines, Planes

# ----
bold = BooleanToggle(True)

# ---- group: Arrange slices
bbox = BoundingBox(Content=mesh, Plane=PlaneXY(0, 0, 0))  # -> Box, Box_2
viewer = ParamViewer(bblayer.Outlines)
lng = ListLength(List=viewer)
debox = DeconstructBox(Box=bbox.Box_2)  # -> Plane, X, Y, Z
series = Series(Start=0, Step=debox.Y, Count=lng)
Y = UnitY(Factor=expr("1.1*x", series))
xy = XYPlane(Origin=Y)  # -> graft(Plane)
orient = Orient(Geometry=bblayer.Outlines, Source=bblayer.Planes, Target=xy)  # -> Geometry, Transform
orient_2 = Orient(Geometry=bblayer.Inlines, Source=bblayer.Planes, Target=xy)  # -> Geometry, Transform

# ----
bbtext = BBText(
    Location=PlaneXY(0, 0, 0),
    Text=panel,
    Size=Slider(9, range=0..10),
    Bold=bold,
    HorizontalAlignment=Slider(2, range=0..10),
    VerticalAlignment=Slider(2, range=0..10))
info = Curve(bbtext)
