# Grasshopper definition BBText Example.gh (Grasshopper 0.9.61)
# plug-ins: Bowerbird

panel = Panel("""Bowerbird
by Thomas J. Oberbichler""")
location_point_and_orientation_plane = Plane(Plane(origin=(-9, -17, 0), x=(0.5615014183, 0.8274757744, 0), y=(-0.2754005847, 0.1868789682, 0.9429903336)))
horizontal_alignment = ValueList({"Center": 0, "Left": 1, "Right": 2}, selected="Left")
vertical_alignment = ValueList({"Center": 0, "Top": 1, "Bottom": 2, "Baseline": 3}, selected="Bottom")
bold = BooleanToggle(False)
bbtext = BBText(
    Location=location_point_and_orientation_plane,
    Text=panel,
    Size=Slider(10, range=0..10),
    Bold=bold,
    HorizontalAlignment=horizontal_alignment,
    VerticalAlignment=vertical_alignment)
single_line_text = Curve(bbtext)
