# Grasshopper definition BBWaffle Example - Open Surface (Offset).gh (Grasshopper 1.0.6)
# plug-ins: Bowerbird

# ---- group: Input
number_slider = Slider(8, range=-10..10)
surface = Surface(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)

# ----
number_slider_2 = Slider(10, range=0..100)
number_slider_3 = Slider(12, range=0..100)
base_plane = Plane(PlaneXY(0, 0, 0))

# ---- group: Generate a volume from the surface by offsetting
offset = Offset(Surface=surface, Distance=number_slider, Retrim=True)
edges = BrepEdges(Brep=surface)  # -> Naked, Interior, NonManifold
edges_2 = BrepEdges(Brep=offset)  # -> Naked, Interior, NonManifold
join = JoinCurves(Curves=edges.Naked, Preserve=False)
join_2 = JoinCurves(Curves=edges_2.Naked, Preserve=False)
merge = Merge(Data1=join, Data2=join_2)
loft = Loft(Curves=merge, Options={Adjust=False, Closed=False, LoftEnds=0, LoftSimp=0, LoftType=0, Rebuild=10, Refit=0.01})
merge_2 = Merge(Data1=flatten(surface), Data2=flatten(loft), Data3=flatten(offset))
join_3 = BrepJoin(Breps=merge_2)  # -> Breps, Closed

# ----
panel = Panel("""Bowerbird
by Thomas J. Oberbichler""")
bold = BooleanToggle(True)
bbtext = BBText(
    Location=PlaneXY(0, 0, 0),
    Text=panel,
    Size=Slider(9, range=0..10),
    Bold=bold,
    HorizontalAlignment=Slider(2, range=0..10),
    VerticalAlignment=Slider(1, range=0..10))
info = Curve(bbtext)
volume = Brep(join_3.Breps)
mesh = MeshBrep(
    Brep=volume,
    Settings={GridMaxCount=0, GridMinCount=16, JaggedSeams=False, MaxEdgeLength=0, MinEdgeLength=0.0001, MinTolerance=0, Refine=True, RefineAngle=0, RelativeTolerance=0.65, SimplePlanes=True, Tolerance=0})
bbwaffle = BBWaffle(
    Mesh=mesh,
    DivisionX=number_slider_2,
    DivisionY=number_slider_3,
    Thickness=Slider(0.6, range=0..10),
    Plane=base_plane,
    Deeper=Slider(0.3, range=0..2),
    Project=False,
    Distance=1)  # -> SlicesU, SlicesV, SectionPlanesU, SectionPlanesV

# ---- group: Arrange sections
bbox = BoundingBox(Content=volume, Plane=PlaneXY(0, 0, 0))  # -> Box, Box_2
debox = DeconstructBox(Box=bbox.Box_2)  # -> Plane, X, Y, Z
series = Series(Start=0, Step=debox.Z, Count=expr("x-1", number_slider_2))
series_2 = Series(Start=0, Step=debox.Z, Count=expr("x-1", number_slider_3))
X = UnitX(Factor=expr("1.1*x", debox.X))
Y = UnitY(Factor=expr("1.1*x", series))
Y_2 = UnitY(Factor=expr("1.1*x", series_2))
xy = XYPlane(Origin=Y_2)  # -> graft(Plane)
addition = Addition(A=X, B=Y)
xy_2 = XYPlane(Origin=addition)  # -> graft(Plane)
orient = Orient(Geometry=bbwaffle.SlicesU, Source=bbwaffle.SectionPlanesU, Target=xy_2)  # -> Geometry, Transform
orient_2 = Orient(Geometry=bbwaffle.SlicesV, Source=bbwaffle.SectionPlanesV, Target=xy)  # -> Geometry, Transform

# ----
move = Move(Geometry=[bbwaffle.SlicesU, bbwaffle.SlicesV], Motion=Vector(0, 200, 0))  # -> Geometry, Transform
series_3 = Series(Start=1, Step=1, Count=expr("x-1", number_slider_2))  # -> graft(Series)
series_4 = Series(Start=1, Step=1, Count=expr("x-1", number_slider_3))  # -> graft(Series)
number_slider_4 = Slider(2, range=0..10)
pcen = PolygonCenter(Polyline=orient.Geometry)  # -> CenterV, CenterE, CenterA
pcen_2 = PolygonCenter(Polyline=orient_2.Geometry)  # -> CenterV, CenterE, CenterA
eval = Evaluate(F="\"Y\" & Format(\"{0:0}\", y)", y=series_3)
eval_2 = Evaluate(F="\"X\" & Format(\"{0:0}\", y)", y=series_4)

# ---- group: Bowerbird Text Component
bbtext_2 = BBText(Location=pcen.CenterV, Text=eval, Size=number_slider_4, Bold=False, HorizontalAlignment=0, VerticalAlignment=0)
bbtext_3 = BBText(Location=pcen_2.CenterV, Text=eval_2, Size=number_slider_4, Bold=False, HorizontalAlignment=0, VerticalAlignment=0)
