# Grasshopper definition BBWaffle Example.gh (Grasshopper 1.0.6)
# plug-ins: Bowerbird

# ---- group: Input
number_slider = Slider(8, range=0..10)
number_slider_2 = Slider(8, range=0..10)
number_slider_3 = Slider(0.4, range=0..10)
number_slider_4 = Slider(0, range=0..10)
base_plane = Plane(Plane(origin=(-59, 28, 0), x=(0, 0.9284766909, -0.3713906764), y=(-0.8045740796, 0.2205512062, 0.5513780154)))
brep = Brep(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)

# ----
panel = Panel("""Bowerbird
by Thomas J. Oberbichler""")
bold = BooleanToggle(True)

# ---- group: Convert breps to meshes
mesh = MeshBrep(
    Brep=brep,
    Settings={GridMaxCount=0, GridMinCount=16, JaggedSeams=False, MaxEdgeLength=0, MinEdgeLength=0.0001, MinTolerance=0, Refine=True, RefineAngle=0, RelativeTolerance=0.65, SimplePlanes=True, Tolerance=0})

# ----
bbtext = BBText(
    Location=PlaneXY(0, 0, 0),
    Text=panel,
    Size=Slider(9, range=0..10),
    Bold=bold,
    HorizontalAlignment=Slider(2, range=0..10),
    VerticalAlignment=Slider(2, range=0..10))

# ---- group: Bowerbird Waffle Component
bbwaffle = BBWaffle(
    Mesh=mesh,
    DivisionX=number_slider,
    DivisionY=number_slider_2,
    Thickness=number_slider_3,
    Plane=base_plane,
    Deeper=number_slider_4,
    Project=False,
    Distance=1)  # -> SlicesU, SlicesV, SectionPlanesU, SectionPlanesV

# ----
info = Curve(bbtext)

# ---- group: Arrange sections
bbox = BoundingBox(Content=mesh, Plane=base_plane)  # -> Box, Box_2
debox = DeconstructBox(Box=bbox.Box_2)  # -> Plane, X, Y, Z
series = Series(Start=0, Step=debox.Z, Count=expr("x-1", number_slider_2))
series_2 = Series(Start=0, Step=debox.Z, Count=expr("x-1", number_slider))
X = UnitX(Factor=expr("1.1*x", debox.Y))
Y = UnitY(Factor=expr("1.1*x", series))
Y_2 = UnitY(Factor=expr("1.1*x", series_2))
xy = XYPlane(Origin=Y_2)  # -> graft(Plane)
addition = Addition(A=X, B=Y)
xy_2 = XYPlane(Origin=addition)  # -> graft(Plane)
orient = Orient(Geometry=bbwaffle.SlicesV, Source=bbwaffle.SectionPlanesV, Target=xy_2)  # -> Geometry, Transform
orient_2 = Orient(Geometry=bbwaffle.SlicesU, Source=bbwaffle.SectionPlanesU, Target=xy)  # -> Geometry, Transform

# ----
debox_2 = DeconstructBox(Box=bbox.Box)  # -> Plane, X, Y, Z
X_2 = UnitX(Factor=expr("1.5*x", debox_2.X))
move = Move(Geometry=[bbwaffle.SlicesU, bbwaffle.SlicesV], Motion=X_2)  # -> Geometry, Transform
series_3 = Series(Start=1, Step=1, Count=expr("x-1", number_slider_2))  # -> graft(Series)
series_4 = Series(Start=1, Step=1, Count=expr("x-1", number_slider))  # -> graft(Series)
number_slider_5 = Slider(2, range=0..10)
pcen = PolygonCenter(Polyline=orient.Geometry)  # -> CenterV, CenterE, CenterA
pcen_2 = PolygonCenter(Polyline=orient_2.Geometry)  # -> CenterV, CenterE, CenterA
eval = Evaluate(F="\"Y\" & Format(\"{0:0}\", y)", y=series_3)
eval_2 = Evaluate(F="\"X\" & Format(\"{0:0}\", y)", y=series_4)

# ---- group: Bowerbird Text Component
bbtext_2 = BBText(Location=pcen.CenterV, Text=eval, Size=number_slider_5, Bold=False, HorizontalAlignment=0, VerticalAlignment=0)
bbtext_3 = BBText(Location=pcen_2.CenterV, Text=eval_2, Size=number_slider_5, Bold=False, HorizontalAlignment=0, VerticalAlignment=0)
