# Grasshopper definition Pathfinder - Normal Curvature.gh (Grasshopper 1.0.7)
# plug-ins: Bowerbird2

# ---- group: 2. select surface
brep = Brep(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)

# ---- group: 3. specify starting point
divide = DivideCurve(Curve=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, Count=10, Kinks=False)  # -> Points, Tangents, Parameters

# ---- group: 1. choose path type
bbκn = BBNormalCurvaturePath(Value=0, Angle=0, Direction=3)

# ---- group: 4. run pathfinder
bbpathfinder = BBPathfinder(PathType=bbκn, Surface=brep, StartPoint=divide.Points, StepSize=0.1, MaximumNumberOfPoints=10000, StartPointType=0)

# ----
item = ListItem(List=flatten(bbpathfinder), Index=0, Wrap=True)

# ---- group: 5. extrude lamellas
extrude = BBExtrudeCurveOnSurface(CurveOnSurface=bbpathfinder, Thickness=1, Offset=0, Unroll=False)

# ---- group: 6. measure normal curvature
κn = BBNormalCurvatureCurveOnSurface(CurveOnSurface=reparameterize(item), Parameter=Slider(0.5, range=0..1))  # -> Point, Curvature, OsculatingCircle

# ----
vlen = VectorLength(Vector=κn.Curvature)
panel = Panel(vlen)
